# Grasshopper definition 200515_carpet.gh (Grasshopper 1.0.7)

list = ValueList()
python = GhPythonScript(x=list)  # -> out, a, b
# ---------- python: Python ----------
__author__ = "gregorjahner"

# Import points from a text file
import rhinoscriptsyntax as rs
import csv
import ghpythonlib.treehelpers as th
#import pandas as pd

def calTotalNumberOfSpots():
    #df = pd.read_csv("top_spots.csv", usecols = ['0'])
    #return df['0'].sum()
    pass


def CSVlist():
    #prompt the user for a file to import
    filter = "CSV file (*.csv)|*.csv|*.txt|All Files (*.*)|*.*||"
    filename = rs.OpenFileName("top_spots", filter)
    if not filename: return

    tmplist = list()
    with open(filename) as csvfile:
    #with open('top_spots.csv') as csvfile:
        reader = csv.reader(csvfile)
        #reader = csv.reader(csvfile, delimiter=',')
        header_idx = True
        for row in reader:
            if header_idx == True:
                header_idx = False
                #print(row)
                continue

            lat = float(row[0])
            long = float(row[1])
            alt = float(row[2])
            print(lat, long, alt)

            rs.AddPoint(lat, long, alt)
            tmplist.append([lat, long, alt])
    print(tmplist)
    b = th.list_to_tree(tmplist)
    return b

"""
if( __name__ == "__main__" ):
    CSVlist()
    #calTotalNumberOfSpots()

"""
b = CSVlist()
# ---------- end python ----------
number_of_total_items = ListLength(List=graft(python.b))
panel = Panel(python.b)
branch = TreeBranch(Tree=simplify(python.b), Path=Slider(4, range=1..9), MaintainPaths=True)
branch_2 = TreeBranch(Tree=simplify(python.b), Path=Slider(8, range=1..9), MaintainPaths=True)
branch_3 = TreeBranch(Tree=simplify(python.b), Path=Slider(5, range=1..9), MaintainPaths=True)
branch_4 = TreeBranch(Tree=simplify(python.b), Path=Slider(3, range=1..9), MaintainPaths=True)
branch_5 = TreeBranch(Tree=simplify(python.b), Path=Slider(9, range=1..9), MaintainPaths=True)
branch_6 = TreeBranch(Tree=simplify(python.b), Path=Slider(7, range=1..9), MaintainPaths=True)
branch_7 = TreeBranch(Tree=simplify(python.b), Path=Slider(6, range=1..9), MaintainPaths=True)
branch_8 = TreeBranch(Tree=simplify(python.b), Path=Slider(1, range=1..9), MaintainPaths=True)
branch_9 = TreeBranch(Tree=simplify(python.b), Path=Slider(0, range=0..100), MaintainPaths=True)
branch_10 = TreeBranch(Tree=simplify(python.b), Path=Slider(2, range=1..9), MaintainPaths=True)
panel_2 = Panel(branch)
panel_3 = Panel(branch_2)
panel_4 = Panel(branch_4)
panel_5 = Panel(branch_5)
panel_6 = Panel(branch_6)
panel_7 = Panel(branch_3)
panel_8 = Panel(branch_7)
panel_9 = Panel(branch_9)
panel_10 = Panel(branch_10)
panel_11 = Panel(branch_8)
item = ListItem(
    List=[panel_3, panel_5, panel_6, panel_8, panel_7, panel_2, panel_4, panel_10, panel_11, panel_9],
    Index=Slider(0, range=0..100),
    Wrap=True)  # -> flatten(Item)
item_2 = ListItem(
    List=[panel_3, panel_5, panel_6, panel_8, panel_7, panel_2, panel_4, panel_10, panel_11, panel_9],
    Index=Slider(1, range=0..100),
    Wrap=True)  # -> flatten(Item)
pt = ConstructPoint(XCoordinate=item, YCoordinate=item_2, ZCoordinate=0)
